% Simulink data dictionary controllerParams.sldd

guidanceParams = Simulink.Parameter(struct(phiCmd_rad=0, thetaCmd_rad=0, psiCmd_rad=0))

innerLoopParams = Simulink.Parameter(struct(
  upRateLimitPitchYaw_dps=300,
  loRateLimitPitchYaw_dps=-300,
  upLimitPitchYaw_deg=15,
  loLimitPitchYaw_deg=-15,
  fbkGainBreakpoints_Pa=[0 1],
  fbkGainP_na=[1 1],
  fbkGainI_na=[1 1],
  fbkGainD_na=[1 1],
  fbkGainN_na=[1 1]))

outerLoopParams = Simulink.Parameter(struct(
  upRateLimitPitchYawRate_rps2=5,
  loRateLimitPitchYawRate_rps2=-5,
  upLimitPitchYawRate_rps=2,
  loLimitPitchYawRate_rps=-2,
  pitchYawGains=[1 0 0 100],
  upRateLimitRollRate_rps2=5,
  loRateLimitRollRate_rps2=-5,
  upLimitRollRate_rps=2,
  loLimitRollRate_rps=-2,
  rollGains=[1 0 0 100]))